# Grasshopper definition parametricFacade.gh (Grasshopper 1.0.7)
# plug-ins: LunchBox

crv = Curve(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)
number_slider = Slider(4, range=2..12)
number_slider_2 = Slider(3, range=3..12)
S = Surface(crv)
mesh_uv = MeshSurface(Surface=S, UCount=number_slider_2, VCount=number_slider, Overhang=True, Equalize=False)
demesh = DeconstructMesh(Mesh=mesh_uv)  # -> Vertices, Faces, Colours, Normals
qgrid = QuadGrid(Surface=S, UDivisions=number_slider_2, VDivisions=number_slider)  # -> CornerPoint1, CornerPoint2, CornerPoint3, CornerPoint4, MidPoint, Normals
# Paracourse.com
# Paracourse members can
# download 4 additional facade scripts.
preview = CustomPreview(
    Geometry=Tree({0;0;0;0;0;0;0}: [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], {0;0;0;0;1;0;0}: [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], {0;0;0;0;2;0;0}: [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], {0;0;0;0;3;0;0}: [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], {0;0;0;0;4;0;0}: [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], {0;0;0;0;5;0;0}: [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], {0;0;0;0;6;0;0}: [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], {0;0;0;0;7;0;0}: [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], {0;0;0;0;8;0;0}: [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], {0;0;0;0;9;0;0}: [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], {0;0;0;0;10;0;0}: [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], {0;0;0;0;11;0;0}: [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]),
    Material=ColourSwatch(SwatchColor=RGB(255, 162, 0)))
edges = BrepEdges(Brep=Tree({0;0;0;0;0;0;0}: [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], {0;0;0;0;1;0;0}: [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], {0;0;0;0;2;0;0}: [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], {0;0;0;0;3;0;0}: [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], {0;0;0;0;4;0;0}: [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], {0;0;0;0;5;0;0}: [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], {0;0;0;0;6;0;0}: [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], {0;0;0;0;7;0;0}: [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], {0;0;0;0;8;0;0}: [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], {0;0;0;0;9;0;0}: [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], {0;0;0;0;10;0;0}: [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], {0;0;0;0;11;0;0}: [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]))  # -> Naked, Interior, NonManifold
lng = ListLength(List=demesh.Vertices)
genes = GenePool(Decimals=1, Maximum=10, Minimum=-10, Value=[-4.874947804, 2.5])
edges_2 = BrepEdges(Brep=Tree({0;0}: [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], {0;1}: [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], {0;2}: [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], {0;3}: [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], {0;4}: [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], {0;5}: [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]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))  # -> Naked, Interior, NonManifold
Y = UnitY(Factor="5.5")
preview_2 = CustomPreview(
    Geometry=Tree({0;0}: [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], {0;1}: [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], {0;2}: [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], {0;3}: [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], {0;4}: [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], {0;5}: [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], {0;6}: [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], {0;7}: [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], {0;8}: [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], {0;9}: [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], {0;10}: [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], {0;11}: [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]),
    Material=ColourSwatch(SwatchColor=RGB(45, 226, 255)))
num = Number(genes)
repeat = RepeatData(Data=num, Length=lng)
multiplication = Multiplication(A=demesh.Normals, B=repeat)
move = Move(Geometry=demesh.Vertices, Motion=Y)  # -> Geometry, Transform
preview_3 = CustomPreview(
    Geometry=Tree({0;0}: [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], {0;1}: [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], {0;2}: [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], {0;3}: [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], {0;4}: [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], {0;5}: [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]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),
    Material=ColourSwatch(SwatchColor=RGB(0, 0, 0)))
move_2 = Move(Geometry=demesh.Vertices, Motion=multiplication)  # -> Geometry, Transform
python = GhPythonScript(x=number_slider_2, y=number_slider)  # -> out, a; inputs x: Int32, y: Int32
# ---------- python: Python ----------
import rhinoscriptsyntax as rs

a = []

for i in range(x):
    for j in range(y):
        a.append(j + (y+1) * i)
# ---------- end python ----------
conmesh = ConstructMesh(Vertices=move_2.Geometry, Faces=demesh.Faces)
addition = Addition(A=python.a, B=number_slider, C="1")
item = ListItem(List=move.Geometry, Index=python.a, Wrap=True)
item_2 = ListItem(List=move.Geometry, Index=addition, Wrap=True)
addition_2 = Addition(A=python.a, B=number_slider, C="2")
item_3 = ListItem(List=move.Geometry, Index=addition_2, Wrap=True)
medges = MeshEdges(Mesh=conmesh)  # -> NakedEdges, InteriorEdges, NonManifoldEdges
addition_3 = Addition(A=python.a, B=1)
item_4 = ListItem(List=move.Geometry, Index=addition_3, Wrap=True)
item_5 = ListItem(List=move_2.Geometry, Index=addition_3, Wrap=True)
item_6 = ListItem(List=move_2.Geometry, Index=python.a, Wrap=True)
item_7 = ListItem(List=move_2.Geometry, Index=addition, Wrap=True)
item_8 = ListItem(List=move_2.Geometry, Index=addition_2, Wrap=True)
srf4pt = _4PointSurface(CornerA=item, CornerB=item_4, CornerC=item_3, CornerD=item_2)
srf4pt_2 = _4PointSurface(CornerA=item_4, CornerB=item_3, CornerC=item_8, CornerD=item_5)
srf4pt_3 = _4PointSurface(CornerA=item_6, CornerB=item_5, CornerC=item_8, CornerD=item_7)
srf4pt_4 = _4PointSurface(CornerA=item, CornerB=item_6, CornerC=item_7, CornerD=item_2)
srf4pt_5 = _4PointSurface(CornerA=item, CornerB=item_4, CornerC=item_5, CornerD=item_6)
srf4pt_6 = _4PointSurface(CornerA=item_2, CornerB=item_7, CornerC=item_8, CornerD=item_3)
python_2 = GhPythonScript(x=srf4pt_3, y=srf4pt_4, z=srf4pt_5, u=srf4pt, v=srf4pt_6, w=srf4pt_2)  # -> out, a; inputs x: Brep, y: Brep, z: Brep, u: Brep, v: Brep, w: Brep
# ---------- python_2: Python ----------
import rhinoscriptsyntax as rs
import ghpythonlib.components as gh

a = gh.BrepJoin([x,y,z,u,v,w])[0]
# ---------- end python_2 ----------
debrep = DeconstructBrep(Brep=python_2.a)  # -> Faces, Edges, Vertices
item_9 = ListItem(List=debrep.Faces, Index=Slider(0, range=0..5), Wrap=True)  # -> flatten(Item)
debrep_2 = DeconstructBrep(Brep=item_9)  # -> Faces, Edges, Vertices
join = JoinCurves(Curves=debrep_2.Edges, Preserve=False)  # -> flatten(Curves)
offsets = OffsetOnSrf(Curve=join, Distance="-1", Surface=item_9)  # -> flatten(Curve)
explode = Explode(Curve=offsets, Recursive=True)  # -> Segments, Vertices
cullpt = CullDuplicates(Points=explode.Vertices, Tolerance=0.1, CullMode=3)  # -> flatten(Points), Indices, Valence
python_3 = GhPythonScript(x=cullpt.Points, a=Slider(4.5, range=2..5), b=Slider(1.1, range=-3..3))  # -> out, nPoints; inputs x: Point3d
# ---------- python_3: Python ----------
import rhinoscriptsyntax as rs
import ghpythonlib.components as gh

if x[1] < 0:
    nPoints =gh.Move(x,gh.UnitY(a))[0]
else:
    nPoints =gh.Move(x,gh.UnitY(b))[0]
# ---------- end python_3 ----------
python_4 = GhPythonScript(x=python_3.nPoints, y=cullpt.Points)  # -> out, a, b, c; inputs x: list of Point3d, y: list of Point3d
# ---------- python_4: Python ----------
import rhinoscriptsyntax as rs
import ghpythonlib.components as gh

a = []
b = []
c = []

for i in range(int(len(x)/4)):
    t = i*4
    a.append(gh.x4PointSurface(x[t],x[t+1],x[t+2],x[t+3]))

t = 0

for i in range(int(len(x)/4)):
    t = i * 4
    b.append(gh.x4PointSurface(x[t],y[t],y[t+1],x[t+1]))
    b.append(gh.x4PointSurface(x[t+1],y[t+1],y[t+2],x[t+2]))
    b.append(gh.x4PointSurface(x[t+2],y[t+2],y[t+3],x[t+3]))
    b.append(gh.x4PointSurface(x[t+3],y[t+3],y[t],x[t]))

for i in range(int(len(x)/4)):
    t = i*4
    cutter = (gh.Extrude(gh.PolyLine([x[t],x[t+1],x[t+2],x[t+3]],True),gh.UnitY(-10)))
    c.append(cutter)
# ---------- end python_4 ----------
split = SplitBrep(Brep=item_9, Cutter=python_4.c)
item_10 = ListItem(List=debrep.Faces, Index=Slider(1, range=0..5), Wrap=True)  # -> flatten(Item), flatten(Item1), flatten(Item2), flatten(Item3), flatten(Item4)
item_11 = ListItem(List=split, Index=0, Wrap=True)  # -> flatten(Item)
data = Data(python_4.a)
preview_4 = CustomPreview(
    Geometry=[python_4.b, item_11, item_10.Item1, item_10.Item2, item_10.Item3, item_10.Item4],
    Material=ColourSwatch(SwatchColor=RGB(255, 162, 0)))
join_2 = BrepJoin(Breps=[python_4.b, item_11, python_4.a, item_10.Item1, item_10.Item2, item_10.Item3, item_10.Item4])  # -> Breps, Closed
quads = QuadPanels(Surface=data, UDivisions=Slider(2, range=1..3), VDivisions=Slider(2, range=1..3))
frame = PanelFrame(Panel=quads, ScaleFactor="0.8")  # -> PanelFrame, Panel
preview_5 = CustomPreview(Geometry=frame.Panel, Material=ColourSwatch(SwatchColor=RGB(45, 226, 255)))
preview_6 = CustomPreview(Geometry=frame.PanelFrame, Material=ColourSwatch(SwatchColor=RGB(0, 0, 0)))
